# Grasshopper definition demo_v2.ghx (Grasshopper 1.0.7)

number_slider = Slider(100, range=0..100)

# ---- group: backup
geometry = Geometry([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])
geometry_2 = Geometry([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])
geometry_3 = Geometry([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])
geometry_4 = Geometry([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])
geometry_5 = Geometry([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])
geometry_6 = Geometry([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])
geometry_7 = Geometry([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])
geometry_8 = Geometry([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])
geometry_9 = Geometry([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])
geometry_10 = Geometry([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])
geometry_11 = Geometry([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])
merge = Merge(
    Data1=geometry_8,
    Data2=geometry,
    Data3=geometry_2,
    Data4=geometry_3,
    Data5=geometry_4,
    Data6=geometry_5,
    Data7=geometry_6,
    Data8=geometry_7,
    Data9=geometry_9,
    Data10=geometry_10,
    Data11=geometry_11)  # -> flatten(Result)

# ----
ghpython_script = GhPythonScript(file_name="simulation.py")  # -> path
# ---------- ghpython_script: Python ----------
a = ghdoc.Path
b = ghdoc.Name

path = (a[::-1].replace('xhg.'+b[::-1].replace('*','',1),'',1))[::-1]+file_name
# ---------- end ghpython_script ----------
read_file = ReadFile(File=ghpython_script, PerLineParse=False)

pt = ConstructPoint(XCoordinate="0", YCoordinate="0", ZCoordinate="0")

# ---- group: backup
custom_preview = CustomPreview(Geometry=merge, Material=ColourSwatch(SwatchColor=RGBA(232, 0, 0, 249)))

# ----
geometry_12 = Geometry([Plane(origin=(130.5129571, 928.2940481, 95.29507717), x=(0.8660254069, 0, 0.4999999947), y=(-0.2499999971, 0.866025404, 0.4330127031)), Plane(origin=(112.6329571, 928.2940481, 95.29507717), x=(0.8660254069, 0, 0.4999999947), y=(-0.2499999971, 0.866025404, 0.4330127031)), Plane(origin=(94.75295712, 928.2940481, 95.29507717), x=(0.8660254069, 0, 0.4999999947), y=(-0.2499999971, 0.866025404, 0.4330127031)), Plane(origin=(76.87295712, 928.2940481, 95.29507717), x=(0.8660254069, 0, 0.4999999947), y=(-0.2499999971, 0.866025404, 0.4330127031)), Plane(origin=(138.512957, 900.5812352, 81.43867067), x=(0.8660254069, 0, 0.4999999947), y=(-0.2499999971, 0.866025404, 0.4330127031)), Plane(origin=(120.632957, 900.5812352, 81.43867067), x=(0.8660254069, 0, 0.4999999947), y=(-0.2499999971, 0.866025404, 0.4330127031))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])
construct_plane = ConstructPlane(Origin=pt, XAxis=Vector(1, 0, 0), YAxis=Vector(0, 1, 0))

# ---- group: FABRICATION WORKFLOW
python = GhPythonScript(Code=read_file, ROBOT_IP="192.168.10.10", Fabricate=Button(), Debug_plane=construct_plane)  # -> Out, Robot_base_plane, Script, Debug_plane

# ----
toggle_freedrive = GhPythonScript(ip="192.168.10.10", start_teach_mode=Toggle(False), stop_teach_mode=Toggle(False))  # -> a
# ---------- toggle_freedrive: Python ----------
import os
import math

from compas.rpc import Proxy

if start_teach_mode:   
    canvas = ghenv.Component.OnPingDocument()
    path = os.path.abspath(os.path.dirname(canvas.FilePath))
    rtde = Proxy('fabrication', path=path)                         # stay in teach moded(freedrive) as long as this is True
    a = rtde.start_teach_mode(ip=ip)            # send message to robot
    ghenv.Component.Message = "Freedrive on"    # display message on GH component

if stop_teach_mode:   
    canvas = ghenv.Component.OnPingDocument()
    path = os.path.abspath(os.path.dirname(canvas.FilePath))
    rtde = Proxy('fabrication', path=path)                          # stop teach mode if stop button pressed
    a = rtde.stop_teach_mode(ip=ip)             # send message to robot   
    ghenv.Component.Message = "Freedrive off"   # display message on GH component
# ---------- end toggle_freedrive ----------

list_item = ListItem(List=merge, Index=0, Wrap=True)
list_item_2 = ListItem(List=merge, Index=0, Wrap=True)
deconstruct_brep = DeconstructBrep(Brep=list_item_2)  # -> Faces, Edges, Vertices
list_item_3 = ListItem(List=deconstruct_brep.Faces, Index=Slider(5, range=0..10), Wrap=True)

# ---- group: Table
geometry_13 = Geometry(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)

# ---- group: Robot Base
geometry_14 = Geometry(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)

# ---- group: Pickup Station
geometry_15 = Geometry(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)

# ----
list_item_4 = ListItem(List=deconstruct_brep.Vertices, Index=0, Wrap=True)  # -> Item, Item1, Item2, Item3, Item4, Item5, Item6, Item7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
geometry_16 = Geometry(list_item_4.Item4)
deconstruct_plane = DeconstructPlane(Plane=list_item_3)  # -> Origin, XAxis, YAxis, ZAxis
ghpython_script_2 = GhPythonScript(file_name="robot_listen.py")  # -> path; same code as ghpython_script
vector_2pt = Vector2Pt(PointA=deconstruct_plane.Origin, PointB=list_item_4.Item4, Unitize=False)  # -> Vector, Length
vector_2pt_2 = Vector2Pt(PointA=deconstruct_plane.Origin, PointB=list_item_4.Item6, Unitize=False)  # -> Vector, Length
read_file_2 = ReadFile(File=ghpython_script_2, PerLineParse=False)
multiplication = Multiplication(A=vector_2pt.Vector, B=0.5)
multiplication_2 = Multiplication(A=vector_2pt_2.Vector, B=0.5)
ghpython_script_3 = GhPythonScript(button=Toggle(True), ROBOT_IP="192.168.10.10")  # -> out, a
# ---------- ghpython_script_3: Python ----------
from imp import reload
import Rhino.Geometry as rg
import simple_ur_script as ur
reload(ur)
import simple_comm as c
reload(c)
import math as m
from compas.geometry import Frame
from compas_rhino.conversions import frame_to_rhino

def tcp(script):
    # script += ur.set_tcp_by_angles(-0.35, 0.5, 89.08, m.radians(0.0), m.radians(3.1415),m.radians(0.0))
    # script += ur.set_tcp_by_angles(-0.35, 0.5, 89.08, m.radians(0.0), m.radians(0),m.radians(0.0))
    script += ur.set_tcp_by_angles(-0.35, 0.5, 89.08, 0.0, 3.1415, 1.57)
    
    return script
def send(script):
    script = c.concatenate_script(script)
    c.send_script(script, ROBOT_IP)
    return script 
    
    
    
script = ''
if button:
    script = tcp(script)
    send (script)
# ---------- end ghpython_script_3 ----------

# ---- group: Get robot pose
ghpython_script_4 = GhPythonScript(Code=read_file_2, Listen=Toggle(True), Robot_base_plane=python.Robot_base_plane)  # -> Out, Pose, Config

# ----
addition = Addition(A=multiplication_2, B=multiplication)
move = Move(Geometry=deconstruct_plane.Origin, Motion=addition)  # -> Geometry, Transform
panel = Panel(ghpython_script_4.Out)
radians = Radians(Degrees=ghpython_script_4.Config)
construct_plane_2 = ConstructPlane(Origin=move.Geometry, XAxis=deconstruct_plane.YAxis, YAxis=expr("-x", deconstruct_plane.XAxis))
geometry_17 = Geometry()
list_item_5 = ListItem(List=radians, Index=0, Wrap=True)  # -> Item, Item1, Item2, Item3, Item4, Item5
geometry_18 = Geometry(Plane(origin=(130.5129571, 928.2940481, 95.29507717), x=(0.8986609222, -0.1455916388, 0.4137772608), y=(-0.03696385885, 0.9148193651, 0.4021681271)))
ghpython_script_5 = GhPythonScript(
    x=list_item_5.Item,
    y=list_item_5.Item1,
    z=list_item_5.Item2,
    u=list_item_5.Item3,
    v=list_item_5.Item4,
    w=list_item_5.Item5)  # -> configuration
# ---------- ghpython_script_5: Python ----------
import rhinoscriptsyntax as rs

from compas.robots import configuration
from compas_fab.robots import Configuration

configuration = Configuration.from_revolute_values([x,y,z,u,v,w])
# ---------- end ghpython_script_5 ----------
orient = Orient(Geometry=merge, Source=construct_plane_2, Target=geometry_18)  # -> Geometry, Transform
boolean_toggle = BooleanToggle(True)
ur10e = GhPythonScript()  # -> robot
# ---------- ur10e: Python ----------
import os

import compas_fab
from compas.artists import Artist
from compas.geometry import Frame
from compas.robots import RobotModel
from compas.robots.resources import LocalPackageMeshLoader
from compas_fab.backends import AnalyticalInverseKinematics
from compas_fab.backends import OffsetWristKinematics
from compas_fab.backends.interfaces import ClientInterface
from compas_fab.robots import Robot
from compas_fab.robots import RobotSemantics


canvas = ghenv.Component.OnPingDocument()
#
urdf_folder = os.path.join(os.path.dirname(canvas.FilePath), '../dependencies/robots')
#urdf_file = os.path.join(urdf_folder, 'ur10e.urdf')

srdf_file = os.path.join(urdf_folder, 'ur10e.srdf')
#model = RobotModel.from_urdf_file(urdf_file)
#model = RobotModel.from_urdf_file('C:\Zac\GitHub\endless-wall-teamwork\dependencies\ur10.urdf')
urdf_file = compas_fab.get('universal_robot/ur_description/urdf/ur5.urdf')
model = RobotModel.from_urdf_file(urdf_file)

loader = LocalPackageMeshLoader(compas_fab.get('universal_robot'), 'ur_description')
model.load_geometry(loader)

semantics = RobotSemantics.from_srdf_file(srdf_file, model)

client = ClientInterface()
client.is_connected = True
client.inverse_kinematics = AnalyticalInverseKinematics(solver='ur10e')

robot = Robot(model, client=client, semantics=semantics)
robot.artist = Artist(model)
# ---------- end ur10e ----------
deconstruct_plane_2 = DeconstructPlane(Plane=construct_plane_2)  # -> Origin, XAxis, YAxis, ZAxis
deconstruct_plane_3 = DeconstructPlane(Plane=geometry_18)  # -> Origin, XAxis, YAxis, ZAxis
geometry_19 = Geometry(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)
geometry_20 = Geometry([Plane(origin=(4326.842561, 496.4232481, 95.07750284), x=(0.8660254069, 0, 0.4999999947), y=(-0.2499999971, 0.866025404, 0.4330127031)), Plane(origin=(4308.962561, 496.4232481, 95.07750284), x=(0.8660254069, 0, 0.4999999947), y=(-0.2499999971, 0.866025404, 0.4330127031)), Plane(origin=(4291.082561, 496.4232481, 95.07750284), x=(0.8660254069, 0, 0.4999999947), y=(-0.2499999971, 0.866025404, 0.4330127031)), Plane(origin=(4273.202561, 496.4232481, 95.07750284), x=(0.8660254069, 0, 0.4999999947), y=(-0.2499999971, 0.866025404, 0.4330127031)), Plane(origin=(4334.842561, 468.7104352, 81.22109634), x=(0.8660254069, 0, 0.4999999947), y=(-0.2499999971, 0.866025404, 0.4330127031)), Plane(origin=(4316.962561, 468.7104352, 81.22109634), x=(0.8660254069, 0, 0.4999999947), y=(-0.2499999971, 0.866025404, 0.4330127031))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])
robot_visualize = COMPASFABRobotVisualize(
    robot=ur10e,
    configuration=ghpython_script_5,
    show_collision=boolean_toggle,
    show_frames=boolean_toggle,
    show_cm=Toggle(False),
    show_acm=Toggle(False))  # -> visual, collision, collision_meshes, attached_meshes, frames, base_frame, ee_frame; inputs show_visual: Boolean, show_collision: Boolean, show_frames: Boolean, show_base_frame: Boolean, show_end_effector_frame: Boolean, show_cm: Boolean, show_acm: Boolean
#   port group: The planning group used for end-effector and base visualization.
#   port configuration: The robot's full configuration.
#   port show_visual: Whether or not to show the robot's visual meshes.
#   port show_collision: Whether or not to show the robot's collision meshes.
#   port show_frames: Whether or not to show the robot's joint frames.
#   port show_base_frame: Whether or not to show the robot's base frame.
#   port show_end_effector_frame: Whether or not to show the robot's end-effector frame.
#   port show_cm: Whether or not to show the collision meshes (if any).
#   port show_acm: Whether or not to show the attached collision meshes (if any).
#   port visual: Rhino meshes of the robot's visual geometry (if any).
#   port collision: Rhino meshes of the robot's collision geometry (if any).
#   port collision_meshes: Rhino meshes of the scene's collision meshes (if any).
#   port attached_meshes: Rhino meshes of the scene's attached collision meshes (if any).
#   port frames: The robot's joint frames as Rhino planes (if any).
#   port base_frame: The robot's base frame as a Rhino plane (if any).
#   port ee_frame: The robot's end-effector frame as a Rhino plane (if any).
# ---------- robot_visualize: Python ----------
"""
Visualizes the robot.

COMPAS FAB v0.27.0
"""
from compas.artists import Artist
from compas.geometry import Frame
from compas.geometry import Transformation
from compas_fab.robots import PlanningScene
from ghpythonlib.componentbase import executingcomponent as component
import Rhino.Geometry as rg


class RobotVisualize(component):
    def RunScript(
        self,
        robot,
        group,
        configuration,
        show_visual,
        show_collision,
        show_frames,
        show_base_frame,
        show_end_effector_frame,
        show_cm,
        show_acm,
    ):

        visual = None
        collision = None
        collision_meshes = None
        attached_meshes = None
        frames = None
        base_frame = None
        ee_frame = None

        if robot:
            show_visual = True if show_visual is None else show_visual
            show_cm = True if show_cm is None else show_cm
            show_acm = True if show_acm is None else show_acm
            configuration = configuration or robot.zero_configuration()

            robot.update(configuration, visual=show_visual, collision=show_collision)
            compas_frames = robot.transformed_frames(configuration, group)

            if show_visual:
                visual = robot.artist.draw_visual()

            if show_collision:
                collision = robot.artist.draw_collision()

            if show_base_frame:
                base_compas_frame = compas_frames[0]
                artist = Artist(base_compas_frame)
                base_frame = artist.draw()

            if show_end_effector_frame:
                ee_compas_frame = robot.forward_kinematics(
                    configuration, group, options=dict(solver="model")
                )
                artist = Artist(ee_compas_frame)
                ee_frame = artist.draw()

            if show_frames:
                frames = []
                for compas_frame in compas_frames[1:]:
                    artist = Artist(compas_frame)
                    frame = artist.draw()
                    frames.append(frame)

            if show_cm or show_acm:
                scene = PlanningScene(robot)
                scene = robot.client.get_planning_scene()

                collision_meshes = []
                attached_meshes = []

                if show_cm:
                    for co in scene.world.collision_objects:
                        header = co.header
                        frame_id = header.frame_id
                        cms = co.to_collision_meshes()

                        for cm in cms:
                            if cm.frame != Frame.worldXY():
                                t = Transformation.from_frame(cm.frame)
                                mesh = cm.mesh.transformed(t)
                            else:
                                mesh = cm.mesh

                            collision_meshes.append(Artist(mesh).draw())

                if show_acm:
                    for aco in scene.robot_state.attached_collision_objects:
                        for acm in aco.to_attached_collision_meshes():
                            frame_id = aco.object["header"]["frame_id"]
                            frame = robot.forward_kinematics(
                                configuration, options=dict(link=frame_id)
                            )
                            t = Transformation.from_frame(frame)

                            # Local CM frame
                            if (
                                acm.collision_mesh.frame
                                and acm.collision_mesh.frame != Frame.worldXY()
                            ):
                                t = t * Transformation.from_frame(
                                    acm.collision_mesh.frame
                                )

                            mesh = acm.collision_mesh.mesh.transformed(t)

                            attached_meshes.append(Artist(mesh).draw())
#        for v in visual:
#            v.Transform(rg.Transform.Scale(rg.Point3d(0,0,0),10))
        return (
            visual,
            collision,
            collision_meshes,
            attached_meshes,
            frames,
            base_frame,
            ee_frame,
        )
# ---------- end robot_visualize ----------
vector_2pt_3 = Vector2Pt(PointA=deconstruct_plane_2.Origin, PointB=deconstruct_plane_3.Origin, Unitize=False)  # -> Vector, Length
move_2 = Move(Geometry=construct_plane_2, Motion=vector_2pt_3.Vector)  # -> Geometry, Transform
orient_2 = Orient(Geometry=geometry_19, Source=construct_plane_2, Target=move_2.Geometry)  # -> Geometry, Transform
orient_3 = Orient(Geometry=merge, Source=construct_plane_2, Target=move_2.Geometry)  # -> Geometry, Transform
orient_4 = Orient(Geometry=geometry_20, Source=construct_plane_2, Target=move_2.Geometry)  # -> Geometry, Transform
scale = Scale(Geometry=robot_visualize.visual, Center=Point(0, 0, 0), Factor=1000)  # -> Geometry, Transform
geometry_21 = Geometry(scale.Geometry)
